# Dynamo graph example02.dyn (Dynamo 0.9.1.4054)

code_block = CodeBlock { 400; }
byLengths = Cuboid.ByLengths(width=code_block, length=code_block, height=code_block)
edges = Face.Edges(byLengths)
curveGeometry = Edge.CurveGeometry(edges)
endPoint = Curve.EndPoint(curveGeometry)
startPoint = Curve.StartPoint(curveGeometry)
byStartPointEndPoint = Line.ByStartPointEndPoint(startPoint=endPoint, endPoint=startPoint)
code_block_2 = CodeBlock { 40; }
byLengths_2 = Cuboid.ByLengths(width=code_block_2, length=code_block_2, height=code_block_2)
byPointsLinesGeometries = WireFrameToRobot.Node.ByPointsLinesGeometries(endPoint, byStartPointEndPoint, byLengths_2)
testAngular2_Node = Dynamo_TORO.WIP_ROBARCH.testAngular2_Node(byPointsLinesGeometries)
code_block_3 = CodeBlock { Vector.ByCoordinates(0,0,1); }
testAngular1_Node = Dynamo_TORO.WIP_ROBARCH.testAngular1_Node(byPointsLinesGeometries, code_block_3)
alignByXAxis_Node = Dynamo_TORO.WIP_ROBARCH.alignByXAxis_Node(byPointsLinesGeometries)
