# Dynamo graph SimpleOptimization.dyn (Dynamo 1.0.0.526)

# group: Inputs for Node Strut Model
code_block = CodeBlock { 6; }
averageStrutsVector = WireFrameToRobot.OrientationStrategy.AverageStrutsVector()
code_block_2 = CodeBlock { 20; }
byLengths = Cuboid.ByLengths(width=code_block_2, length=code_block_2, height=code_block_2)

# group: Scale Factor For Diameters
code_block_3 = CodeBlock { 0.8; }

# group: Create the cooling tower form
code_block_4 = CodeBlock { 1200; }
code_block_5 = CodeBlock(base=code_block_4) { baseh = base; bottomRing = 0; midh = baseh + base; toph = midh +baseh; }
code_block_6 = CodeBlock(base=code_block_4) { bottomRing = base * 1.5; mid = base / 1.2; top = mid * 1.1; }

create = List.Create(code_block_5.bottomRing, code_block_5.baseh, code_block_5.midh, code_block_5.toph)
byCoordinates = Point.ByCoordinates(z=create)
create_2 = List.Create(code_block_6.bottomRing, code_block_4, code_block_6.mid, code_block_6.top)

# group (continued): Create the cooling tower form
code_block_7 = CodeBlock(x=create_2, diameterScaleFactor=code_block_3) { x*diameterScaleFactor; }

byCenterPointRadius = Circle.ByCenterPointRadius(centerPoint=byCoordinates, radius=code_block_7)

# group (continued): Create the cooling tower form
byLoft = Surface.ByLoft(byCenterPointRadius)

# group: Bounds Info
boundingBox = Geometry.BoundingBox(byLoft)
toCuboid = BoundingBox.ToCuboid(boundingBox)

averageStrutsAlignToZExactly = WireFrameToRobot.OrientationStrategy.AverageStrutsAlignToZExactly()
averageStrutsVector_2 = WireFrameToRobot.OrientationStrategy.AverageStrutsVector()
averageStrutsFindTypes = WireFrameToRobot.OrientationStrategy.AverageStrutsFindTypes()
generateNewSolution = WireFrameToRobot.StrutUtilities.StrutMaterialEvaluator.GenerateNewSolution()
loopWhile = LoopWhile(arg2=generateNewSolution)
struts = WireFrameToRobot.StrutUtilities.StrutSolution.Struts(loopWhile)
isNull = Object.IsNull()
not_ = Not()
compose = ComposeFunctions(isNull, not_)  # "Function.Compose"
passing = WireFrameToRobot.StrutUtilities.StrutSolution.Passing()
count = Count()
code_block_8 = CodeBlock { 20; }
lt = _ < code_block_8
compose_2 = ComposeFunctions(passing, count, lt)  # "Function.Compose"
and_ = _ && compose_2
compose_3 = ComposeFunctions(compose, and_)  # "Function.Compose"
code_block_9 = CodeBlock { false; }
apply = ApplyFunction(compose_3, code_block_9)  # "Function.Apply"
code_block_10 = CodeBlock()
# ---------- code_block_10.designscript (21 lines) ----------
def continueFunction(solution : StrutSolution, numPassing: var)
{
//cannot execute this function call inside
//the imperative code block...?
isNull = DSCore.Object.IsNull(solution);
return = [Imperative]
 {
 if(isNull)
 {
 //if the input is null break out of the while loop
 return = false;
 }
 else
 {
 //if the number of passing struts is low, keep
 //looping
 return = Count(solution.Passing) < numPassing;
 }

 };
};
# ----------------------------------------
code_block_11 = CodeBlock { Function.Function(continueFunction,2,{1},{null,5},true); }

# group: Tessellate
code_block_12 = CodeBlock { 8; }
code_block_13 = CodeBlock { 8; }
lunchbox_triangle_grid_by_face = Custom[LunchBox Triangle Grid by Face](Surface=byLoft, U=code_block_12, V=code_block_13)  # Create a Triangular XYZ grid on a face. The face surface must have an untrimmed UV parameter space.

# group: Get All Lines and Points that represent the form - There are duplicates in this list
code_block_14 = CodeBlock(lines=lunchbox_triangle_grid_by_face.Panel_Polys) { lines; }
explode = Geometry.Explode(code_block_14)
flatten = Flatten(explode)
startPoint = Curve.StartPoint(flatten)
endPoint = Curve.EndPoint(flatten)
byStartPointEndPoint = Line.ByStartPointEndPoint(startPoint=startPoint, endPoint=endPoint)

code_block_15 = CodeBlock { 100; }
byWidthLength = Rectangle.ByWidthLength(width=code_block_15, length=code_block_15)
averageStrutsAlignToStrut = WireFrameToRobot.OrientationStrategy.AverageStrutsAlignToStrut()
byPointsLinesAndGeoOrientationStrategy = WireFrameToRobot.Node.ByPointsLinesAndGeoOrientationStrategy(startPoint, byStartPointEndPoint, byWidthLength, byLengths, averageStrutsAlignToStrut)
findUniqueStruts = WireFrameToRobot.Node.FindUniqueStruts(byPointsLinesAndGeoOrientationStrategy)
wood1 = WireFrameToRobot.Material.Wood1()
generateInitialSolutionByStrutsMaterial = WireFrameToRobot.StrutUtilities.StrutMaterialEvaluator.GenerateInitialSolutionByStrutsMaterial(findUniqueStruts, wood1)
apply_2 = ApplyFunction(code_block_11, generateInitialSolutionByStrutsMaterial)  # "Function.Apply"
